# Grasshopper definition Multi-Step Callibration Scan Sequence.gh (Grasshopper 1.0.7)
# plug-ins: RemoSharp, Machina

scan_file_folder = Panel("C:\scan_file_folder")
save_to_file = BooleanToggle(False)

connect_to_python_scanner = BooleanToggle(False)
robot_name = ValueList({"UoT", "BTU"}, selected="UoT")
robot_move_and_scan = Button()
connect_to_machina = BooleanToggle(False)

rg6 = OnrobotRG6(FingerDistance=Slider(9, range=0..100), Power_limit=80, WaitTime=2500)
connect = Connect(URL="ws://127.0.0.1:6999/Bridge", Name="GH", Connect=connect_to_machina)  # -> Status, Bridge

listen = Listen(Bridge=connect.Bridge, Autoupdate=True, Interval=66)
actionexecuted = ActionExecuted(BridgeMessage=listen)  # -> LastAction, ActionTCP, ActionAxes, ActionExternalAxes, PendingActions, PendingActionsOnDevice
pln = Plane(actionexecuted.ActionTCP)

send = Send(Bridge=connect.Bridge, Actions=rg6, Send=Button())  # -> Sent, Instructions

# ---- group: UoT / manual positioning of the robot around the qr codes
pt = Point(Point(1189.83746, 322.4097169, -69.89704178))
pt_2 = Point(Point(639.6094454, -203.3993093, -59.56857249))
pt_3 = Point(Point(1112.417234, -224.189994, -9.34058953))
pt_4 = Point(Point(760.6394346, 388.819582, -11.81913743))

# ---- group: btu / manual positioning of the robot around the qr codes
pt_5 = Point(Point(564.339208, -496.7874931, -262.0454401))
pt_6 = Point(Point(884.9367274, -489.9034588, -252.008609))
pt_7 = Point(Point(822.2418304, 371.6273742, -276.3160774))
pt_8 = Point(Point(507.8263373, 360.637083, -267.9775134))

# ---- group: Connection to Local Server for Scanner messages
websocketclient = WebSocketClient(
    Url="ws://localhost:18580",
    Connect=connect_to_python_scanner,
    Auto_Update=False,
    Keep_Alive=True,
    Keep_Record=False,
    Listen=True)

# ----
pt_9 = ConstructPoint(XCoordinate="1.66", YCoordinate="-5.27", ZCoordinate="300.9")

pt_10 = ConstructPoint(XCoordinate="0", YCoordinate="0", ZCoordinate="300.9")

# ---- group: UoT
merge = Merge(Data1=pt_2, Data2=pt_3, Data3=pt, Data4=pt_4)

# ---- group: btu
merge_2 = Merge(Data1=pt_5, Data2=pt_6, Data3=pt_7, Data4=pt_8)

# ----
c_script = CSharpScript(pl=pln)  # -> out, A, B; inputs pl: Plane
# ---------- c_script: C# usings ----------
using System.IO;
# ---------- c_script: C# ----------
    //    index = (index + 1) % 30;
    //    pl.Translate(Vector3d.ZAxis * index * 1);
    
    B = PlaneToStringInPipe(pl);
# ---------- c_script: C# additional code ----------
  //  int index = 0;

  string PlaneToString(Plane pl)
  {
    string og = pl.Origin.X + "," + pl.Origin.Y + "," + pl.Origin.Z;
    string x = pl.XAxis.X + "," + pl.XAxis.Y + "," + pl.XAxis.Z;
    string y = pl.YAxis.X + "," + pl.YAxis.Y + "," + pl.YAxis.Z;
    return og + ";" + x + ";" + y;
  }
  
  string PlaneToStringInPipe(Plane pl)
  {
    string og = pl.Origin.X + "," + pl.Origin.Y + "," + pl.Origin.Z;
    string x = pl.XAxis.X + "," + pl.XAxis.Y + "," + pl.XAxis.Z;
    string y = pl.YAxis.X + "," + pl.YAxis.Y + "," + pl.YAxis.Z;
    return "|" + og + ";" + x + ";" + y + "|";
  }

  Plane StringToPlane(string txt)
  {
    string[] parts = txt.Split(';');
    string[] og = parts[0].Split(',');
    string[] x = parts[1].Split(',');
    string[] y = parts[2].Split(',');
    return new Plane(new Point3d(double.Parse(og[0]), double.Parse(og[1]), double.Parse(og[2])),
      new Vector3d(double.Parse(x[0]), double.Parse(x[1]), double.Parse(x[2])),
      new Vector3d(double.Parse(y[0]), double.Parse(y[1]), double.Parse(y[2])));

  }

  void WritePlane(string path, Plane pl)
  {
    string txt = PlaneToString(pl);
    File.WriteAllText(path, txt);
  }
# ---------- end c_script ----------
python = GhPythonScript(x=merge_2, y=robot_name, z=merge)  # -> out, a
# ---------- python: Python ----------
__author__ = "akhaj"
__version__ = "2024.06.18"

import rhinoscriptsyntax as rs


if (y == "UoT"):
    a = z
elif (y == "BTU"):
    a = x
# ---------- end python ----------
panel = Panel(c_script.B)

# ---- group: Send the robot scanning (the second scan is triggered automatically if the first scan is successful)
or = GateOr(B=robot_move_and_scan)

only_scan = Button()
or_2 = GateOr(A=or, B=only_scan)
wsclientsendmsg = WSClientSendMsg(WSClient=websocketclient, Send=or_2, Message="startRecording")

only_robot = Button()
or_3 = GateOr(A=only_robot, B=or)

# ----
concat = Concatenate(FragmentA=scan_file_folder, FragmentB="\bonsai_mockup.json")

# ---- group: to test the websocket connection
wsclientsendmsg_2 = WSClientSendMsg(WSClient=websocketclient, Send=Toggle(True), Message=c_script.B)

# ----
number_slider = Slider(20, range=0..100)
precisionto = PrecisionTo(Radius=Slider(0, range=0..100), Relative=False)
pt_11 = Point(Point(687.6796451, -173.6585997, 390.1724481))
pt_12 = Point(Point(154.4345645, -173.6585997, 164.5457776))
moveto = MoveTo(Point=pt_12, Relative=False)
moveto_2 = MoveTo(Point=pt_11, Relative=False)
number_slider_2 = Slider(250, range=0..1000)

# ---- group: Send the robot to home and a retracted pose before turning off
home = HomeAxes()
retract = RetractPosition()
merge_3 = Merge(Data1=home, Data2=retract)
send_2 = Send(Bridge=connect.Bridge, Actions=merge_3, Send=Button())  # -> Sent, Instructions

# ----
neg = Negative(Value=number_slider_2)
addition = Addition(A=neg, B=Slider(0, range=0..1000))
Z = UnitZ(Factor=addition)

# ---- group: Scanner Coordinates Shift Values
number_slider_3 = Slider(39.5, range=-70..70)
number_slider_4 = Slider(-33, range=-70..70)
number_slider_5 = Slider(44, range=0..1000)

# ----
number_slider_6 = Slider(250, range=0..1000)
number_slider_7 = Slider(600, range=0..1000)
neg_2 = Negative(Value=Slider(9, range=0..10))
neg_3 = Negative(Value=Slider(100, range=0..1000))
neg_4 = Negative(Value=number_slider_7)
Z_2 = UnitZ(Factor=neg_2)
concat_2 = Concatenate(FragmentA="robot_plane", FragmentB=robot_name, FragmentC=".csv")
X = UnitX(Factor=neg_3)
Y = UnitY(Factor=number_slider_7)
rep = ReplaceText(Text=concat, Find="bonsai_mockup.json", Replace=concat_2, RecursiveReplace=False)
move = Move(Vector=X, Relative=True)
panel_2 = Panel(rep)
c_script_2 = CSharpScript(path=rep)  # -> out, A; inputs path: String
# ---------- c_script_2: C# ----------
    A = ReadPlane(path);
# ---------- c_script_2: C# additional code ----------
  Plane ReadPlane(string path)
  {
    string txt = File.ReadAllText(path);
    return StringToPlane(txt);
  }
  Plane StringToPlane(string txt)
  {
    string[] parts = txt.Split(';');
    string[] og = parts[0].Split(',');
    string[] x = parts[1].Split(',');
    string[] y = parts[2].Split(',');
    return new Plane(new Point3d(double.Parse(og[0]), double.Parse(og[1]), double.Parse(og[2])),
      new Vector3d(double.Parse(x[0]), double.Parse(x[1]), double.Parse(x[2])),
      new Vector3d(double.Parse(y[0]), double.Parse(y[1]), double.Parse(y[2])));

  }
# ---------- end c_script_2 ----------

# ---- group: Tool Setup values
pt_13 = ConstructPoint(XCoordinate="-0.08", YCoordinate="-0.07", ZCoordinate="318.35")
attachtool = AttachTool(ToolName="rg")
speedto = SpeedTo(Speed=Slider(35, range=0..100), Relative=False)

# ----
python_2 = GhPythonScript(x=pt_9, y=robot_name, z=pt_13)  # -> out, a; same code as python

# ---- group: Tool Setup values (continued)
xy = XYPlane(Origin=python_2.a)
definetool = DefineTool(Name="rg", BasePlane=PlaneXY(0, 0, 0), TCPPlane=xy, Weight=Slider(1.25, range=0..10))
merge_4 = Merge(Data1=flatten(definetool), Data2=flatten(attachtool), Data3=flatten(speedto), Data4=flatten(precisionto))
send_3 = Send(Bridge=connect.Bridge, Actions=merge_4, Send=Button())  # -> Sent, Instructions

# ----
robot_tool_setup = Data(merge_4)

# ---- group: 1st step scan records and processing
trigger = Trigger(Interval=200, TimerInterval=200, Target=wslisten)
wslisten = WSListen(WSClient=websocketclient)
c_script_3 = CSharpScript(RESET=or_2, msg=wslisten, Reference="C:\Users\akhaj\AppData\Roaming\Grasshopper\Libraries\RemoSharp\Newtonsoft.Json.dll")  # -> out, A, B, C, D, send, message; inputs RESET: Boolean, msg: String
# ---------- c_script_3: C# usings ----------
using Newtonsoft.Json;
using System.Linq;
# ---------- c_script_3: C# ----------
    if (RESET) qrplanes = new Dictionary<string, QRPlane>();

    if (string.IsNullOrEmpty(msg)) return;

    if (!msg.Contains("|")){

      List<QRPlane> incomingQRPlanes = QRPlane.DeserializeList(msg);

      foreach (QRPlane item in incomingQRPlanes)
      {
        if (qrplanes.ContainsKey(item.qr_content))
        {
          qrplanes[item.qr_content] = item;
        }
        else
        {
          qrplanes.Add(item.qr_content, item);
        }
      }

      var sorted = qrplanes.OrderBy(x => x.Value.qr_content).ToDictionary(x => x.Key, x => x.Value);

      pntTree = new DataTree<Point3d>();
      plnTree = new DataTree<Plane>();

      QRPlane firstPlane = qrplanes.Values.FirstOrDefault();
      QRPlane secondPlane = qrplanes.Values.Skip(1).FirstOrDefault();
      QRPlane third = qrplanes.Values.Skip(2).FirstOrDefault();
      QRPlane forth = qrplanes.Values.Skip(3).FirstOrDefault();

      if (firstPlane != null) pntTree.AddRange(firstPlane.PointFromCorners(), new GH_Path(0));
      if (secondPlane != null) pntTree.AddRange(secondPlane.PointFromCorners(), new GH_Path(1));
      if (third != null) pntTree.AddRange(third.PointFromCorners(), new GH_Path(2));
      if (forth != null) pntTree.AddRange(forth.PointFromCorners(), new GH_Path(3));

      if (firstPlane != null) plnTree.Add(firstPlane.BasePlane(), new GH_Path(0));
      if (secondPlane != null) plnTree.Add(secondPlane.BasePlane(), new GH_Path(1));
      if (third != null) plnTree.Add(third.BasePlane(), new GH_Path(2));
      if (forth != null) plnTree.Add(forth.BasePlane(), new GH_Path(3));
    }

    A = pntTree;
    B = plnTree;

    C = DictToList(qrplanes);


    bool allSolid = qrplanes.Keys.Count != 4 ? false : true;

    foreach (QRPlane item in DictToList(qrplanes))
    {
      if (!item.solid)
      {
        allSolid = false;
        break;
      }
    }

    D = allSolid;

    //    if (allSolid) finishedFirstScan = true;
    //
    //    send = false;
    //    message = "";
    //
    //    if (finishedFirstScan) return;
    //
    //
    //    index = (index + 1) % 4;
    //    QRPlane messagePlane = qrplanes.Values.Skip(index).FirstOrDefault();
    //    bool isQRPlaneSolid = messagePlane == null;
    //    if (!isQRPlaneSolid){
    //      send = isQRPlaneSolid || messagePlane.solid_sent_count >= 5 ? false : messagePlane.solid;
    //      message = isQRPlaneSolid ? "" : string.Format("{0}|{1}|{2}", messagePlane.qr_content, true, messagePlane.basePlane);
    //      if (isQRPlaneSolid && messagePlane.solid_sent_count < 7) messagePlane.solid_sent_count++;
    //    }
# ---------- c_script_3: C# additional code ----------
  //  int index = 0;
  //  bool finishedFirstScan = false;

  DataTree<Point3d> pntTree = new DataTree<Point3d>();
  DataTree<Plane> plnTree = new DataTree<Plane>();


  List<QRPlane> DictToList(Dictionary<string, QRPlane> dict)
  {
    return dict.Values.ToList();
  }

  Dictionary<string,QRPlane> qrplanes = new Dictionary<string, QRPlane>();

  public class Corner
  {
    public double x;
    public double y;
    public double d;

    public Corner(){}
    public Corner(int x, int y, int d)
    {
      this.x = x;
      this.y = y;
      this.d = d;
    }
  }

  public class QRPlane
  {
    public List<Corner> corners;
    public string qr_content;
    public double standard_deviation = 1000;
    public bool solid = false;
    public string base_plane = "";
    public int solid_sent_count = 0;

    public QRPlane(){}
    public QRPlane(List<Corner> corners, string qr_content, int standard_deviation, bool solid)
    {
      this.corners = corners;
      this.qr_content = qr_content;
      this.standard_deviation = standard_deviation;
      this.solid = solid;
    }

    public Plane BasePlane()
    {
      string[] parts = this.base_plane.Split(';');
      string[] og = parts[0].Split(',');
      string[] x = parts[1].Split(',');
      string[] y = parts[2].Split(',');
      return new Plane(new Point3d(double.Parse(og[0]), double.Parse(og[1]), double.Parse(og[2])),
        new Vector3d(double.Parse(x[0]), double.Parse(x[1]), double.Parse(x[2])),
        new Vector3d(double.Parse(y[0]), double.Parse(y[1]), double.Parse(y[2])));
    }

    public static QRPlane Deserialize(string json)
    {
      return JsonConvert.DeserializeObject<QRPlane>(json);
    }

    public static List<QRPlane> DeserializeList(string json)
    {
      List<QRPlane> incom_qrplanes = new List<QRPlane>();
      List<string> strs = JsonConvert.DeserializeObject<List<string>>(json);

      foreach (var item in strs)
      {
        incom_qrplanes.Add(Deserialize(item));
      }

      return incom_qrplanes;
    }

    public Point3d[] PointFromCorners()
    {
      return this.corners.Select(o => new Point3d(o.x, o.y, o.d)).ToArray();
    }

    override public string ToString()
    {
      return string.Format("QRPlane: {0}, standard dv: {1}, solid: {2}, base: {3}", this.qr_content, this.standard_deviation, this.solid, this.base_plane);
    }

    static string PlaneToString(Plane pl)
    {
      string og = pl.Origin.X + "," + pl.Origin.Y + "," + pl.Origin.Z;
      string x = pl.XAxis.X + "," + pl.XAxis.Y + "," + pl.XAxis.Z;
      string y = pl.YAxis.X + "," + pl.YAxis.Y + "," + pl.YAxis.Z;
      return og + ";" + x + ";" + y;
    }

  }
# ---------- end c_script_3 ----------
avr = Average(Input=c_script_3.A)
c_script_4 = CSharpScript(pnts=c_script_3.A, av=avr)  # -> out, A; inputs pnts: list of Point3d, av: Point3d
# ---------- c_script_4: C# ----------
    Plane pl01 = MakePlane(pnts[0], pnts[1], av, 0);
    Plane pl02 = MakePlane(pnts[1], pnts[2], av, 3);
    Plane pl03 = MakePlane(pnts[2], pnts[3], av, 2);
    Plane pl04 = MakePlane(pnts[3], pnts[0], av, 1);

    Plane[] pls = {pl01, pl02, pl03, pl04};

    A = pls;
# ---------- c_script_4: C# additional code ----------
  Plane MakePlane(Point3d og, Point3d x, Point3d y, double rotation)
  {
    Plane pl = new Plane(og, x - og, y - og);
//    pl.Rotate(rotation, pl.ZAxis, pl.Origin);

    pl.Rotate(rotation * Math.PI / 2, pl.ZAxis, pl.Origin);
    //    pl.Flip();

    return pl;
  }
# ---------- end c_script_4 ----------
deplane = DeconstructPlane(Plane=c_script_4.A)  # -> Origin, XAxis, YAxis, ZAxis
avr_2 = Average(Input=deplane.XAxis)
avr_3 = Average(Input=deplane.YAxis)
avr_4 = Average(Input=deplane.Origin)
pt_14 = ConstructPoint(XCoordinate=0, YCoordinate=0, ZCoordinate=number_slider_2)
pl = ConstructPlane(Origin=avr_4, XAxis=avr_2, YAxis=avr_3)
xy_2 = XYPlane(Origin=pt_14)
orient = Orient(Geometry=pl, Source=xy_2, Target=c_script_3.B)  # -> Geometry, Transform

# ----
singlet = SingleTrueFilter(Trigger=c_script_3.D, Boolean=c_script_3.D)

# ---- group: 1st step scan records and processing (continued)
wsclientsendmsg_3 = WSClientSendMsg(WSClient=websocketclient, Send=singlet, Message="restartRecording")

# ----
panel_3 = Panel(c_script_3.C)
move_2 = Move(Geometry=orient.Geometry, Motion=Z)  # -> Geometry, Transform

# ---- group: Second Step Scan automatic trigger
pln_2 = Plane(Plane(origin=(592.179, -261.228, 67.99), x=(0, -1, 0), y=(-1, 0, 0)))
project = Project(Geometry=pln_2, Plane=orient.Geometry)  # -> Geometry, Transform
c_script_5 = CSharpScript(go=c_script_3.D, RESET=or)  # -> out, A; inputs go: Boolean, RESET: Boolean
# ---------- c_script_5: C# ----------
    if (RESET) sent = false;
    if (sent) return;
    if(go && counter == 0)
    {
      counter++;
      A = true;
      sent = true;
    }
    else
    {
      if( !go)
      {
        counter = 0;
        A = false;
      }
      else
      {
        counter++;
        A = false;
      }
    }
    if (counter > 100) counter = 5;
# ---------- c_script_5: C# additional code ----------
  int counter = 0;
  bool sent = false;
# ---------- end c_script_5 ----------
pl_origin = PlaneOrigin(Base=project.Geometry, Origin=orient.Geometry)
wsclientsendmsg_4 = WSClientSendMsg(WSClient=websocketclient, Send=c_script_5.A, Message="restartRecording")
flatten = FlattenTree(Tree=pl_origin, Path="{0}")
moveto_3 = MoveTo(Point=flatten, Relative=False)
multiplication = Multiplication(A=Slider(18, range=0..100), B=Slider(1000, range=0..12000))
wait = Wait(Time=multiplication)
lng = ListLength(List=moveto_3)
pt_15 = Point(Point(687.6796451, -173.6585997, 390.1724481))
dup = DuplicateData(Data=wait, Number=lng, Order=True)
pt_16 = Point(Point(154.4345645, -173.6585997, 164.5457776))
moveto_4 = MoveTo(Point=pt_15, Relative=False)
speedto_2 = SpeedTo(Speed=Slider(75, range=0..100), Relative=False)
weave = Weave(Pattern=[0, 1], Stream0=moveto_3, Stream1=dup, NullGaps=False)
moveto_5 = MoveTo(Point=pt_16, Relative=False)
merge_5 = Merge(Data1=moveto_4, Data2=flatten(speedto_2), Data3=flatten(weave), Data4=moveto_4, Data5=moveto_5)
send_4 = Send(Bridge=connect.Bridge, Actions=merge_5, Send=c_script_5.A)  # -> Sent, Instructions

# ---- group: first and second scan results
panel_4 = Panel(panel_3)

# ---- group: first QR code look out scan
xy_3 = XYPlane(Origin=python.a)
number_slider_8 = Slider(1000, range=0..12000)
rotpl = RotatePlane(plane=xy_3, X=0, Y=0, Z=Slider(180, range=0..1000), flip=Toggle(True), glb=False)
precisionto_2 = PrecisionTo(Radius=Slider(0, range=0..100), Relative=False)
lng_2 = ListLength(List=rotpl)
transformto = TransformTo(Plane=rotpl, Relative=False)

# ----
multiplication_2 = Multiplication(A=Slider(10, range=0..100), B=number_slider_8)

# ---- group: first QR code look out scan (continued)
wait_2 = Wait(Time=multiplication_2)
dup_2 = DuplicateData(Data=wait_2, Number=lng_2, Order=True)
weave_2 = Weave(Pattern=[0, 1], Stream0=transformto, Stream1=dup_2, NullGaps=False)
merge_6 = Merge(Data1=merge_4, Data3=precisionto_2, Data4=flatten(weave_2), Data5=moveto)
send_5 = Send(Bridge=connect.Bridge, Actions=merge_6, Send=or_3)  # -> Sent, Instructions

# ----
pln_3 = Plane(Plane(origin=(592.179, -261.228, 67.99), x=(0, -1, 0), y=(-1, 0, 0)))
c_script_6 = CSharpScript(basePL=pln_3, pl=move_2.Geometry)  # -> out, A; inputs basePL: Plane, pl: Plane
# ---------- c_script_6: C# ----------
    if (pl.ZAxis.Z > 0) pl.Rotate(Math.PI, pl.YAxis, pl.Origin);

    if (Math.Abs(pl.XAxis * basePL.XAxis) < 0.5) pl.Rotate(Math.PI / 2.0, pl.ZAxis, pl.Origin);

    if (pl.XAxis * basePL.XAxis < 0) pl.Rotate(Math.PI, pl.ZAxis, pl.Origin);

    A = pl;
# ---------- end c_script_6 ----------
flatten_2 = FlattenTree(Tree=c_script_6.A, Path="{0}")
vec = VectorXYZ(XComponent=number_slider_3, YComponent=number_slider_4, ZComponent=number_slider_5)  # -> Vector, Length

item = ListItem(List=flatten_2, Index=0, Wrap=True)  # -> Item, Item1, Item2, Item3
merge_7 = Merge(Data1=item.Item, Data2=item.Item1, Data3=item.Item2, Data4=item.Item3)

points = PointList(Points=flatten_2, Size=Slider(32, range=0..100))

move_3 = Move(Geometry=merge_7, Motion=vec.Vector)  # -> Geometry, Transform

# ---- group: Average of base center from multiple QR codes
pln_4 = Plane(move_3.Geometry)
deplane_2 = DeconstructPlane(Plane=pln_4)  # -> Origin, XAxis, YAxis, ZAxis
avr_5 = Average(Input=deplane_2.Origin)
avr_6 = Average(Input=deplane_2.XAxis)
avr_7 = Average(Input=deplane_2.YAxis)
pl_2 = ConstructPlane(Origin=avr_5, XAxis=avr_6, YAxis=avr_7)

# ----
Z_3 = UnitZ(Factor=1)
Z_4 = UnitZ(Factor=Slider(18, range=0..1000))
multiplication_3 = Multiplication(A=Z_3, B=Slider(750, range=0..1000))
move_4 = Move(Geometry=pl_2, Motion=Z_4)  # -> Geometry, Transform
move_5 = Move(Geometry=pl_2, Motion=multiplication_3)  # -> Geometry, Transform
transformto_2 = TransformTo(Plane=move_5.Geometry, Relative=False)
transformto_3 = TransformTo(Plane=move_4.Geometry, Relative=False)
merge_8 = Merge(Data1=robot_tool_setup, Data3=transformto_3)
singlet_2 = SingleTrueFilter(Trigger=transformto_3, Boolean=Button())
send_6 = Send(Bridge=connect.Bridge, Actions=merge_8, Send=singlet_2)  # -> Sent, Instructions

rotpl_2 = RotatePlane(plane=move_4.Geometry, X=Slider(41, range=0..100), Y=Slider(48, range=0..100), Z=0, flip=False, glb=False)
item_2 = ListItem(List=pln_4, Index=Slider(0, range=0..100), Wrap=True)
move_6 = Move(Geometry=rotpl_2, Motion=Vector(0, 0, 10))  # -> Geometry, Transform
pln_5 = Plane(move_6.Geometry)
pln_6 = Plane(move_4.Geometry)
c_script_7 = CSharpScript(RUN=save_to_file, path=rep, pl=pl_2)  # -> out, A, B; inputs RUN: Boolean, path: String, pl: Plane
# ---------- c_script_7: C# ----------
    //    index = (index + 1) % 30;
    //    pl.Translate(Vector3d.ZAxis * index * 1);
    if (!RUN) return;
    WritePlane(path, pl);
    B = pl;
# ---------- c_script_7: C# additional code ----------
  //  int index = 0;

  string PlaneToString(Plane pl)
  {
    string og = pl.Origin.X + "," + pl.Origin.Y + "," + pl.Origin.Z;
    string x = pl.XAxis.X + "," + pl.XAxis.Y + "," + pl.XAxis.Z;
    string y = pl.YAxis.X + "," + pl.YAxis.Y + "," + pl.YAxis.Z;
    return og + ";" + x + ";" + y;
  }

  Plane StringToPlane(string txt)
  {
    string[] parts = txt.Split(';');
    string[] og = parts[0].Split(',');
    string[] x = parts[1].Split(',');
    string[] y = parts[2].Split(',');
    return new Plane(new Point3d(double.Parse(og[0]), double.Parse(og[1]), double.Parse(og[2])),
      new Vector3d(double.Parse(x[0]), double.Parse(x[1]), double.Parse(x[2])),
      new Vector3d(double.Parse(y[0]), double.Parse(y[1]), double.Parse(y[2])));

  }

  void WritePlane(string path, Plane pl)
  {
    string txt = PlaneToString(pl);
    File.WriteAllText(path, txt);
  }
# ---------- end c_script_7 ----------
transformto_4 = TransformTo(Plane=rotpl_2, Relative=False)
send_7 = Send(Bridge=connect.Bridge, Actions=transformto_4, Send=Button())  # -> Sent, Instructions
